# Grasshopper definition template.gh (Grasshopper 1.0.7)
# plug-ins: MeerkatGIS, SidewalkCOVID19

# ---- group: Parse City Model Data
lot = Curve([<curve referenced from the Rhino model> x241])
toggle = BooleanToggle(False)
# COVID19 Plugin Template
# Unit: Feet
# Required Plugin: COVID19, Meerkat
roof = Brep([<brep referenced from the Rhino model> x478])
curb = Curve([<curve referenced from the Rhino model> x82])

# ---- group: Additional Data
shapefile = ImportShapefile(OnOff=Button())

# ---- group: Analyze Target Sidewalk Segements' Social Distance
toggle_2 = BooleanToggle(False)
number_slider = Slider(2, range=0..100)
number_slider_2 = Slider(6, range=0..10)
number_slider_3 = Slider(2, range=0..10)
number_slider_4 = Slider(5, range=0..10)

# ---- group: Additional Data
subway_gis = FilePath("D:\OneDrive - Harvard University\Documents\Harvard M.Arch I\KPFui\Meerkat\stops_nyc_subway_nov2020.mkgis")
parse_mkgis = ParseMeerkatFile(MeerkatFile=subway_gis)  # -> DateCropped, UserAndMachineNamed, PathForFiles, ShapeType, ShapeCountInSource, BoundsInPointSpace, BoundsInLatLong, FieldNames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

interest_points_gis = FilePath("D:\OneDrive - Harvard University\Documents\Harvard M.Arch I\KPFui\Meerkat\Point_Of_Interest.mkgis")
parse_mkgis_2 = ParseMeerkatFile(MeerkatFile=interest_points_gis)  # -> DateCropped, UserAndMachineNamed, PathForFiles, ShapeType, ShapeCountInSource, BoundsInPointSpace, BoundsInLatLong, FieldNames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

# ---- group: Analyze Pedestrian Traffic
number_slider_5 = Slider(12, range=0..100)
number_slider_6 = Slider(50, range=0..100)
toggle_3 = BooleanToggle(False)
target = Curve([<curve referenced from the Rhino model> x8])
number_slider_7 = Slider(500, range=0..1000)
number_slider_8 = Slider(460, range=0..1000)
number_slider_9 = Slider(0.1, range=0..1)
number_slider_10 = Slider(0.01, range=0..0.01)
number_slider_11 = Slider(50, range=0..100)
interet_points = Point(parse_mkgis_2.GeometryPerShape)
subway_stops = Point(parse_mkgis.GeometryPerShape)

# ---- group: Parse City Model Data
parsemodel = ParseDataInRhinoModel(RoofSurfaces=roof, CurbCurve=curb, LotLinesCurve=lot, ParseData=toggle)  # -> Buildings, CityBlock, LotLines

# ---- group: Analyze Pedestrian Traffic
pedestrian_traffic = PedestrianTrafficVolumeAnalysis(
    Buildings=parsemodel.Buildings,
    Blocks=parsemodel.CityBlock,
    LotLines=parsemodel.LotLines,
    TargetBlocks=target,
    AffectingRadius=number_slider_7,
    SubwayStops=subway_stops,
    InterestPoints=interet_points,
    AverageFloorHeight=number_slider_5,
    AverageSquarefootPerPerson=number_slider_8,
    PercentageOfOccupants=number_slider_9,
    PercentageOfSurroundingOccupants=number_slider_10,
    SubwayPedestrianTraffic=number_slider_6,
    InterestPointsPedestrianTraffic=number_slider_11,
    RunAnalysis=toggle_3)  # -> PedestrianTrafficVolume, TargetBlocks, TargetBuildings, TargetSidewalk, NearbyBuildings, NearbySubwayStops, NearbyInterestPoints

# ----
preview = CustomPreview(
    Geometry=pedestrian_traffic.TargetBuildings,
    Material={diffuse=RGB(221, 160, 221), emission=RGB(66, 48, 66), shine=0.5, specular=RGB(255, 255, 255), transparency=0})

# ---- group: Analyze Target Sidewalk Segements' Social Distance
distance_analysis = SocialDistanceAnalysis(
    PedestrianCount=pedestrian_traffic.PedestrianTrafficVolume,
    SidewalkBrep=pedestrian_traffic.TargetSidewalk,
    Radius=number_slider_7,
    SubwayStops=pedestrian_traffic.NearbySubwayStops,
    InterestPoints=pedestrian_traffic.NearbyInterestPoints,
    AttractionStrength=number_slider,
    DesiredDistance=number_slider_2,
    GridSize=number_slider_3,
    Iteration=number_slider_4,
    RunAnalysis=toggle_2)  # -> AverageDistance, VisualizedDataMap, SmallerThanDesiredDistance, ProblemArea

# ----
mesh = Mesh(distance_analysis.VisualizedDataMap)
mesh_2 = Mesh(distance_analysis.ProblemArea)
panel = Panel(distance_analysis.AverageDistance)
panel_2 = Panel(distance_analysis.SmallerThanDesiredDistance)
